# Grasshopper definition subdivision.gh (Grasshopper 1.0.7)
# plug-ins: Human

python = GhPythonScript(file_name="rooms.json")  # -> out, path
# ---------- python: Python ----------
local_folder = "\\".join(ghenv.Component.OnPingDocument().FilePath.split("\\")[:-1]) + "\\"

path = local_folder + file_name
# ---------- end python ----------
file = ReadFile(File=python.path, PerLineParse=False)
python_2 = GhPythonScript(j=file)  # -> out, areas, names, square, adjacencies
# ---------- python_2: Python ----------
import json

rooms = json.loads(j)

print rooms

print len(rooms)
print rooms[0]["name"]

names = [room["name"] for room in rooms]
areas = [room.get("area", None) for room in rooms]
square = [room.get("square", False) for room in rooms]

adjacencies = []

for room_1 in rooms:
    for room_2 in room_1["adjacency"]:
        adjacency = [names.index(room_1["name"]), names.index(room_2)]
        if adjacency not in adjacencies and list(reversed(adjacency)) not in adjacencies:
            adjacencies.append(adjacency)

adjacencies = json.dumps(adjacencies)
# ---------- end python_2 ----------
panel = Panel(python_2.areas)
lng = ListLength(List=python_2.names)
subtraction = Subtraction(A=lng, B="1")
genes = GenePool(Decimals=2, Maximum=100, Minimum=0, Value=[58, 67.97, 44.8, 44.28, 49.35, 73.58, 43.55, 57.57, 42.17, 52.87])
genes_2 = GenePool(Decimals=2, Maximum=100, Minimum=0, Value=[51.93, 21.4, 75.38, 92.32, 5.56, 90.81, 17.29, 28.48, 45.67])
genes_3 = GenePool(Decimals=2, Maximum=100, Minimum=0, Value=[56.78, 60.99, 27.86, 50.68, 19.93, 41.06, 99.07, 31.66, 32.59])
number_slider = Slider(0.87, range=0..2)
galapagos = Galapagos(fitness=num_3, gene=[genes, genes_2, genes_3, number_slider])
pi = Pi(Factor=number_slider)

resetgenepool = PythonScript(GenePool=genes_3, num_params=subtraction, value="0", Reset=Button())  # inputs GenePool: list, Reset: Boolean
# ---------- resetgenepool: Python ----------
from System import Decimal

# Check input values exist
if num_params > 0:
    
    # Get genepool input parameter (must be first input in this case)
    gp = ghenv.Component.Params.Input[0].Sources[0]
    
    # Update and reset genepool
    if Reset:
        
        # Set gene pool count and values
        gp.Count = num_params
        for i in range(gp.Count):
            gp[i] = int(value)
            
        # Update gene pool
        gp.ExpireSolution(True)
# ---------- end resetgenepool ----------

resetgenepool_2 = PythonScript(GenePool=genes_2, num_params=subtraction, value="0", Reset=Button())  # inputs GenePool: list, Reset: Boolean; same code as resetgenepool

resetgenepool_3 = PythonScript(GenePool=genes, num_params=lng, value="0", Reset=Button())  # inputs GenePool: list, Reset: Boolean; same code as resetgenepool

remap = RemapNumbers(Value=genes_2, Source="0 to 100", Target="0 to 1.9999")  # -> Mapped, Clipped

lng_2 = ListLength(List=genes)
series = Series(Start=0, Step=1, Count=lng_2)
sort = SortList(Keys=genes, ValuesA=series)  # -> Keys, ValuesA

remap_2 = RemapNumbers(Value=genes_3, Source="0 to 100", Target="0.1 to 0.9")  # -> Mapped, Clipped
round = Round(Number=remap.Mapped)  # -> Nearest, Floor, Ceiling
pipeline = GeometryPipeline(
    GroupByLayer=False,
    GroupByType=False,
    IncludeHidden=True,
    IncludeLocked=True,
    LayerFilter="boundary",
    NameFilter="*",
    SublayerFiltering=True,
    TypeFilter=4)
project = Project(Geometry=pipeline, Plane=PlaneXY(0, 0, 0))  # -> Geometry, Transform
area = Area(Geometry=project.Geometry)  # -> Area, Centroid
rotate = Rotate(Geometry=project.Geometry, Angle=pi, Plane=area.Centroid)  # -> Geometry, Transform
panel_2 = Panel(remap_2.Mapped)
panel_3 = Panel(round.Floor)
panel_4 = Panel(sort.ValuesA)
python_3 = GhPythonScript(curve=rotate.Geometry, ds=round.Floor, ss=remap_2.Mapped)  # -> out, curves, edge_lines, graph, adjacencies; inputs curve: Curve, ds: list of Int32, ss: list
# ---------- python_3: Python ----------
import Rhino.Geometry as rh
from scriptcontext import doc
import json

tol = doc.ModelAbsoluteTolerance


class Space:
    
    def __init__(self, curve):
        self.geo = curve
        self.edges = []  #
    
    def get_geo(self):
        return self.geo
    
    def add_edge(self, edge):
        self.edges.append(edge)
    
    def get_edges(self):
        return self.edges
    
    ## new method
    def remove_edge(self, edge):
        self.edges.pop(self.edges.index(edge))
    
    def get_amp(self):
        return rh.AreaMassProperties.Compute(self.get_geo())
    
    def get_area(self):
        return self.get_amp().Area
        
    def get_cp(self):
        return self.get_amp().Centroid


## new class
class Edge:
    
    def __init__(self, curve):
        self.geo = curve
        self.spaces = []  #
    
    def get_geo(self):
        return self.geo
    
    def add_space(self, space):
        self.spaces.append(space)
    
    def get_spaces(self):
        return self.spaces
    
    ## new method
    def remove_space(self, space):
        self.spaces.pop(self.spaces.index(space))

## extract split curve function
def split_curve(curve, split_line):
    inter = rh.Intersect.Intersection.CurveCurve(curve, split_line, tol, tol)
    p = [i.ParameterA for i in inter]
    
    if len(p) > 2:
        for i in range(len(p)):
            
            pt1 = curve.PointAt(p[i-1])
            pt2 = curve.PointAt(p[i])
            
            line = rh.Line(pt1, pt2).ToNurbsCurve()
            cp = line.PointAtNormalizedLength(0.5)
            
            if (curve.Contains(cp) == rh.PointContainment.Inside and 
                        len(rh.Intersect.Intersection.CurveCurve(curve, line, tol, tol)) <= 2):
                p = [p[i-1], p[i]]
                break
    
    pieces = curve.Split(p)
    
    return pieces

def split_space(space, d, s):
    
    curve = space.get_geo()
    
    bb = curve.GetBoundingBox(True)
    base_pt = rh.Point3d(bb.Min.X, bb.Min.Y, 0.0)
    
    x = bb.Max.X - bb.Min.X
    y = bb.Max.Y - bb.Min.Y
    
    dims = [x, y]
    vecs = [rh.Vector3d(1,0,0), rh.Vector3d(0,1,0)]
    
    vec_1 = vecs[d] * dims[d] * s
    new_pt_1 = rh.Point3d(base_pt)
    new_pt_1.Transform(rh.Transform.Translation(vec_1))
    
    other_dir = abs(d - 1)
    
    vec_2 = vecs[other_dir] * dims[other_dir]
    new_pt_2 = rh.Point3d(new_pt_1)
    new_pt_2.Transform(rh.Transform.Translation(vec_2))
    
    
    split_line = rh.Line(new_pt_1, new_pt_2).ToNurbsCurve()
    
    ## replace with function so you can reuse it later
    pieces = split_curve(curve, split_line)
    
    curves = []
    
    for piece in pieces:
        line = rh.Line(piece.PointAtStart, piece.PointAtEnd)
        curve = rh.NurbsCurve.JoinCurves([piece, line.ToNurbsCurve()])
        curves += curve
    
    new_spaces = [Space(curve) for curve in curves]
    new_edge = Edge(line)   #
    
    ## add reference between spaces and edges
    for new_space in new_spaces:
        new_space.add_edge(new_edge)
        new_edge.add_space(new_space)
    
    ## inherit edges from the original space
    
    edges = list(space.get_edges())
    
    for edge in edges:
        
        edge_line = edge.get_geo().ToNurbsCurve()
        edge_parts = split_curve(edge_line, split_line)
        
        if len(edge_parts) > 0:
            ## edge was split
            
            # create new edges from split parts
            new_edges = [Edge(edge_part) for edge_part in edge_parts]
            
            # for each space assigned to the original edge
            for edge_space in edge.get_spaces():
                
                # remove reference to original edge
                edge_space.remove_edge(edge)
                
                # add reference to each new edge to other neighbor
                if edge_space != space:
                    for new_edge in new_edges:
                        edge_space.add_edge(new_edge)
                        new_edge.add_space(edge_space)
            
            ## for each new space
            for new_space in new_spaces:
                
                ## for each new edge
                for new_edge in new_edges:
                    
                    # get center point of edge
                    cp = new_edge.get_geo().PointAtNormalizedLength(0.5)
                    
                    # check if edge is on the current space
                    cont = new_space.get_geo().Contains(cp)
                    
                    # if yes, add reference between space and edge
                    if cont == rh.PointContainment.Coincident:
                        
                        # if yes, add reference between new space and edge
                        new_space.add_edge(new_edge)
                        new_edge.add_space(new_space)
            
            
        else:
            
            # remove reference from edge to old space
            edge.remove_space(space)
            
            ## get center point of new edge
            cp = edge_line.PointAtNormalizedLength(0.5)
            
            ## for each new space
            for new_space in new_spaces:
                
                # check if edge belongs to new space
                cont = new_space.get_geo().Contains(cp)
                
                if cont == rh.PointContainment.Coincident:
                    
                    # if yes, add reference between new space and edge
                    new_space.add_edge(edge)
                    edge.add_space(new_space)
    
    return new_spaces


def split_recursively(spaces, ds, ss):
    
    if len(ds) == 0 or len(ss) == 0:
        return spaces
    
    space = spaces.pop(0)
    d = ds.pop(0)
    s = ss.pop(0)
    
    spaces += split_space(space, d, s)
    
    return split_recursively(spaces, ds, ss)


space = Space(curve)

spaces = split_recursively([space], ds, ss)

curves = [space.get_geo() for space in spaces]

edges = []

for space in spaces:
    for edge in space.get_edges():
        if edge not in edges:
            edges.append(edge)

edge_lines = []
graph = []

## extract adjacencies

# create list to store all adjacencies
adjacencies = []

min_opening = 4.0

for edge in edges:
    
    edge_curve = edge.get_geo().ToNurbsCurve() #
    edge_len = edge_curve.GetLength()   #
    
    if edge_len >= min_opening: #
    
        neighbors = edge.get_spaces()
        
        print(neighbors)
        
        # get edges with doors and arcs
        pts = [space.get_cp() for space in neighbors]
        
        # BUGFIX - more than two nieghbors in degenerate case, need to investigate
        if len(pts) > 2:
            pts = pts[:2]
        
        pts.insert(1, edge_curve.PointAtNormalizedLength(0.5))
        
        c = rh.Arc(*pts)
        if c.IsValid:
            graph.append(c)
        else:
            graph.append(rh.Line(pts[0], pts[-1]))
        
        p1 = edge_curve.PointAtLength((edge_len-min_opening)/2.0)
        edge_lines.append(rh.Line(edge_curve.PointAtStart, p1))
        
        p2 = edge_curve.PointAtLength((edge_len+min_opening)/2.0)
        edge_lines.append(rh.Line(p2, edge_curve.PointAtEnd))
        
        adjacencies.append([spaces.index(n) for n in neighbors])
        
    else:
        edge_lines.append(edge_curve)

adjacencies = json.dumps(adjacencies)
# ---------- end python_3 ----------
neg = Negative(Value=pi)
rotate_2 = Rotate(Geometry=python_3.curves, Angle=neg, Plane=area.Centroid)  # -> Geometry, Transform
rotate_3 = Rotate(Geometry=python_3.edge_lines, Angle=neg, Plane=area.Centroid)  # -> Geometry, Transform
rotate_4 = Rotate(Geometry=python_3.graph, Angle=neg, Plane=area.Centroid)  # -> Geometry, Transform
panel_5 = Panel("""1
0.5""")

python_4 = GhPythonScript(adj_target=python_2.adjacencies, adj_actual=python_3.adjacencies, order=sort.ValuesA)  # -> out, penalty, needed; inputs order: list
# ---------- python_4: Python ----------
import json

adj_target = json.loads(adj_target)
adj_actual = json.loads(adj_actual)

print adj_target
print adj_actual

penalty = [0] * len(order)
needed = [False] * len(adj_actual)

for adj in adj_target:
    
    adj_ordered = [order.index(a) for a in adj]
    
    if adj_ordered in adj_actual:
        print adj_ordered, "found"
        needed[adj_actual.index(adj_ordered)] = True
    
    elif list(reversed(adj_ordered)) in adj_actual:
        print adj_ordered, "found"
        needed[adj_actual.index(list(reversed(adj_ordered)))] = True
    
    else:
        print adj_ordered, "not found"
        penalty[adj_ordered[0]] += 1
        penalty[adj_ordered[1]] += 1

print penalty
# ---------- end python_4 ----------
panel_6 = Panel(python_3.adjacencies)
panel_7 = Panel(python_2.adjacencies)

dispatch = Dispatch(List=rotate_4.Geometry, DispatchPattern=python_4.needed)  # -> ListA, ListB
dash = DashPattern(Curve=dispatch.ListA, Pattern=panel_5)  # -> Dashes, Gaps

swatch = ColourSwatch(SwatchColor=RGB(64, 64, 64))
previewlw = CustomPreviewLineweights(Geometry=rotate_3.Geometry, Shader=swatch, Thickness=Slider(6.3, range=0..10), Absolute=False)
previewlw_2 = CustomPreviewLineweights(
    Geometry=dash.Dashes,
    Shader=ColourSwatch(SwatchColor=RGB(56, 56, 56)),
    Thickness=Slider(2.8, range=0..10),
    Absolute=False)

bbox = BoundingBox(Content=rotate_2.Geometry, Plane=PlaneXY(0, 0, 0))  # -> Box, Box_2

# ---- group: square
item = ListItem(List=python_2.square, Index=sort.ValuesA, Wrap=True)

# ---- group: names
item_2 = ListItem(List=python_2.names, Index=sort.ValuesA, Wrap=True)

# ----
area_2 = Area(Geometry=rotate_2.Geometry)  # -> Area, Centroid
previewlw_3 = CustomPreviewLineweights(Geometry=project.Geometry, Shader=swatch, Thickness=Slider(6.7, range=0..10), Absolute=False)

# ---- group: area targets
item_3 = ListItem(List=python_2.areas, Index=sort.ValuesA, Wrap=True)

# ----
gradient = Gradient(
    LowerLimit=0,
    UpperLimit="4",
    Parameter=python_4.penalty,
    stops=[0: RGB(255, 255, 255), 0.294: RGB(232, 151, 151), 1: RGB(255, 0, 0)])
boundary = BoundarySurfaces(Edges=rotate_2.Geometry)

# ---- group: Squareness
debox = DeconstructBox(Box=bbox.Box_2)  # -> Plane, X, Y, Z
dedomain = DeconstructDomain(Domain=debox.X)  # -> Start, End
dedomain_2 = DeconstructDomain(Domain=debox.Y)  # -> Start, End
subtraction_2 = Subtraction(A=dedomain_2.End, B=dedomain_2.Start)
subtraction_3 = Subtraction(A=dedomain.End, B=dedomain.Start)
merge = Merge(Data1=graft(subtraction_3), Data2=graft(subtraction_2))
bnd = Bounds(Numbers=merge)
dedomain_3 = DeconstructDomain(Domain=bnd)  # -> Start, End
division = Division(A=dedomain_3.End, B=dedomain_3.Start)  # -> flatten(Result)
dispatch_2 = Dispatch(List=division, DispatchPattern=item)  # -> ListA, ListB
subtraction_4 = Subtraction(A=dispatch_2.ListA, B="1")
avr = Average(Input=dispatch_2.ListA)
ma = MassAddition(Input=subtraction_4)  # -> Result, PartialResults
squareness = Panel(ma.Result)

# ----
wires = BrepWireframe(Brep=bbox.Box_2, Density=-1)
preview = CustomPreview(Geometry=boundary, Material=gradient)
panel_8 = Panel(area_2.Area)

ma_2 = MassAddition(Input=python_4.penalty)  # -> Result, PartialResults
addition = Addition(A=ma_2.Result, B="1")
adjacency = Panel(addition)

null = NullItem(Item=item_3)  # -> NullFlags, InvalidFlags, Description
dispatch_3 = Dispatch(List=item_2, DispatchPattern=null.NullFlags)  # -> ListA, ListB
dispatch_4 = Dispatch(List=item_3, DispatchPattern=null.NullFlags)  # -> ListA, ListB
dispatch_5 = Dispatch(List=area_2.Area, DispatchPattern=null.NullFlags)  # -> ListA, ListB
ma_3 = MassAddition(Input=dispatch_4.ListB)  # -> Result, PartialResults
ma_4 = MassAddition(Input=dispatch_5.ListB)  # -> Result, PartialResults
division_2 = Division(A=dispatch_4.ListB, B=ma_3.Result)
multiplication = Multiplication(A=ma_4.Result, B=division_2)
subtraction_5 = Subtraction(A=multiplication, B=dispatch_5.ListB)
abs = Absolute(Value=subtraction_5)
ma_5 = MassAddition(Input=abs)  # -> Result, PartialResults

lng_3 = ListLength(List=dispatch_5.ListA)
repeat = RepeatData(Data="0", Length=lng_3)
weave = Weave(Pattern=null.NullFlags, Stream0=multiplication, Stream1=repeat, NullGaps=False)
python_5 = GhPythonScript(name=item_2, area=area_2.Area, target=weave)  # -> out, tag
# ---------- python_5: Python ----------
if target > 0.1:
    tag = "{}\n{} ({})".format(name, int(area), int(target))
else:
    tag = "{}\n{}".format(name, int(area), int(target))
# ---------- end python_5 ----------
tag = TextTag(Location=area_2.Centroid, Text=python_5.tag)

ma_6 = MassAddition(Input=dispatch_5.ListA)  # -> Result, PartialResults
ma_7 = MassAddition(Input=area_2.Area)  # -> Result, PartialResults
addition_2 = Addition(A=ma_6.Result, B=ma_7.Result)
division_3 = Division(A=addition_2, B=ma_7.Result)
maximize_main_area = Panel(division_3)

# ---- group: Target areas
panel_9 = Panel(dispatch_3.ListB)
panel_10 = Panel(multiplication)

# ----
addition_3 = Addition(A=abs, B=multiplication)
division_4 = Division(A=addition_3, B=multiplication)
sort_2 = SortList(Keys=division_4)  # -> reverse(Keys), ValuesA
item_4 = ListItem(List=sort_2.Keys, Index=0, Wrap=True)
avr_2 = Average(Input=division_4)
num = Number(item_4)

area_deviation = Panel(num)

area_3 = Area(Geometry=bbox.Box_2)  # -> Area, Centroid
division_5 = Division(A=area_3.Area, B=area_2.Area)

panel_11 = Panel(area_3.Area)
dispatch_6 = Dispatch(List=division_5, DispatchPattern=item)  # -> ListA, ListB

subtraction_6 = Subtraction(A=dispatch_6.ListA, B="1")
avr_3 = Average(Input=dispatch_6.ListA)
ma_8 = MassAddition(Input=subtraction_6)  # -> Result, PartialResults
shape = Panel(ma_8.Result)

merge_2 = Merge(Data1=flatten(num), Data2=flatten(division_3), Data3=flatten(avr_3), Data4=flatten(avr), Data5=flatten(addition))
mm = MassMultiplication(Input=merge_2)  # -> Result, PartialResults

# ---- group: OBJECTIVE
num_2 = Number(mm.Result)

# ----
num_3 = Number(num_2)
score = Panel(num_3)
